# Grasshopper definition Trekkekum.gh (Grasshopper 1.0.8)
# plug-ins: Electronova_test

number_slider = Slider(140, range=0..500)
choose_excel_row = Slider(4, range=0..4)
slant_height = Slider(333, range=0..1000)
hoveddel_height = Slider(700, range=0..1000)
toppramme_height = Slider(100, range=0..100)
bunnramme_height = Slider(50, range=0..100)
addition = Addition(A=hoveddel_height, B=bunnramme_height)
toppramme = Toppramme(
    Width=1200,
    Height=toppramme_height,
    Length=1000,
    WallThickness=number_slider,
    BunnrammeAndHoveddelOffset=addition,
    SlantHeight=slant_height,
    NumberInExcelFile=choose_excel_row)
bunnramme = Bunnramme(Width=1200, Height=bunnramme_height, Length=1000, WallThickness=number_slider, NumberInExcelFile=choose_excel_row)
hoveddel = Hoveddel(
    Width=1200,
    Height=hoveddel_height,
    Length=1000,
    WallThickness=number_slider,
    BunnrammeOffset=bunnramme_height,
    NumberInExcelFile=choose_excel_row)
deconstruct_brep = DeconstructBrep(Brep=toppramme)  # -> Faces, Edges, Vertices
unit_x = UnitX(Factor=number_slider)
list_item = ListItem(List=deconstruct_brep.Faces, Index=Slider(3, range=0..20), Wrap=True)
extrude = Extrude(Base=list_item, Direction=unit_x)
model_material = ModelMaterial("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")
custom_preview = CustomPreview(Geometry=[bunnramme, extrude, hoveddel, toppramme], Material=model_material)
